# Dynamo graph elevacionEje_script.dyn (Dynamo 2.3.1.11775)
# packages: Data-Shapes 2021.2.94, Orchid 200.4.0.7938, Clockwork for Dynamo 2.x 2.4.0, archi-lab.net 2022.210.2419, Crumple 2022.2.13, Genius Loci 2021.11.10

hideElements = archilab.Revit.Views.Views.HideElements()  # unwired: view, elements
code_block = CodeBlock { "Elevación por Eje"; }
code_block_2 = CodeBlock()
# ---------- code_block_2.designscript (9 lines) ----------
//buttonText
"INICIAR";
//buttonCancel
"CANCELAR";
//maxHeight

//width
440;
//label
# ----------------------------------------
code_block_3 = CodeBlock { "(Categoria MA)"; }
code_block_4 = CodeBlock { "Grids"; }
byName = Category.ByName(name=code_block_4)
all_elements_of_category = ElementsOfCategory(Category=byName)
code_block_5 = CodeBlock(g=all_elements_of_category) { "ELEVACIÓN EJE "+Revit.Elements.Element.Name(g); }
code_block_6 = CodeBlock { "Building Section (02_MA)"; }
byName_2 = Orchid.RevitProject.Views.ViewType.ByName(name=code_block_6)
byType = Orchid.RevitProject.Views.View.ByType(viewType=byName_2)
code_block_7 = CodeBlock { "Subclasificacion"; }
getParameterValueByName = Element.GetParameterValueByName(element=byType, parameterName=code_block_7)
code_block_8 = CodeBlock { "02_MA"; }
eq = getParameterValueByName == code_block_8
filterByBoolMask = List.FilterByBoolMask(list=byType, mask=eq)
code_block_9 = CodeBlock { "Title on Sheet"; }
getParameterValueByName_2 = Element.GetParameterValueByName(element=filterByBoolMask.in, parameterName=code_block_9)
code_block_10 = CodeBlock { null; }
replaceEmptyLists = Custom[List.ReplaceEmptyLists](seq=getParameterValueByName_2, Replacement=code_block_10)  # package Clockwork for Dynamo 2.x; Replaces all empty lists within a given list with a substitute
eq_2 = code_block_5@L1 == replaceEmptyLists@L2  # lacing=Longest
anyTrue = Orchid.Common.List.AnyTrue(list=eq_2)
filterByBoolMask_2 = List.FilterByBoolMask(list=all_elements_of_category, mask=anyTrue)
code_block_11 = CodeBlock(g=filterByBoolMask_2.out) { "ELEVACIÓN EJE "+Revit.Elements.Element.Name(g); }
code_block_12 = CodeBlock()
# ---------- code_block_12.designscript (8 lines) ----------
//heigth
440;
//elemCount
true;
//sort

//id
false;
# ----------------------------------------
listview_data = Custom[Listview Data](Keys=code_block_11, Values=filterByBoolMask_2.out, Height_optionnal=code_block_12.out0, ShowElementCount_optionnal=code_block_12.out1, ShowId_optionnal=code_block_12.out2)  # package Data-Shapes; Create data for ListView input in UI.MultiInputForm ++ . Check out www.data-shapes.net for more infos.
code_block_13 = CodeBlock { "Escala:"; }
code_block_14 = CodeBlock()
# ---------- code_block_14.designscript (6 lines) ----------
[
"1:50",
"1:75",
"1:100",
"1:125"
];
# ----------------------------------------
code_block_15 = CodeBlock { ":"; }
split = String.Split(str=code_block_14, separator0=code_block_15)
code_block_16 = CodeBlock { 1; }
getItemAtIndex = List.GetItemAtIndex(list=split@L2, index=code_block_16)
toNumber = String.ToNumber(str=getItemAtIndex)
code_block_17 = CodeBlock { 0; false; }
dropdown_data = Custom[DropDown Data](InputName=code_block_13, Keys=code_block_14, Values=toNumber, DefaultValueIndex=code_block_17.out0, Sorted_optional=code_block_17.out1)  # package Data-Shapes; Create data for DropDown input in UI.MultiInputForm ++ . Check out www.data-shapes.net for more infos.
list_create = List.Create(item0=listview_data, item1=dropdown_data)
inputgroup_data = Custom[InputGroup Data](GroupTitle=code_block_3, Inputs=list_create)  # package Data-Shapes; Creates a group of inputs for UI.MultipleInputForm ++ . Check out www.data-shapes.net for more infos !
boolean = BoolSelector(true)
multipleinputform = Custom[MultipleInputForm ++](Description_optional=code_block, ButtonText_optional=code_block_2.out0, Inputs=inputgroup_data, Toggle=boolean, CancelButtonText_optional=code_block_2.out1, Width_optional=code_block_2.out2)  # package Data-Shapes; Create a form with multiple inputs. see www.data-shapes.net for tutorials and infos!
code_block_18 = CodeBlock(x=multipleinputform.User_Inputs)
# ---------- code_block_18.designscript (13 lines) ----------
x;

[Imperative]
{
	if(x == null)
	{
		return = [[],[]];
	}
	else
	{
		return = x;
	}
};
# ----------------------------------------
code_block_19 = CodeBlock(l=code_block_18.out1) { l[0]; }
curve = Grid.Curve(grid=code_block_19)
direction = Line.Direction(line=curve)
normalized = Vector.Normalized(vector=direction)
code_block_20 = CodeBlock(p=normalized) { p.X; }
code_block_21 = CodeBlock { 2; }
round = Math.Round(number=code_block_20, digits=code_block_21)
code_block_22 = CodeBlock { 0; }
le = round <= code_block_22
reverse = Curve.Reverse(curve=curve)
scopeIf = Custom[ScopeIf+](test=le, True=reverse, False=curve, lacing=Shortest)  # package Clockwork for Dynamo 2.x; A (hopefully) more robust implementation of ScopeIf. Tests a single boolean and returns a value accordingly.
code_block_23 = CodeBlock(x=scopeIf) { x; }
direction_2 = Line.Direction(line=code_block_23)
code_block_24 = CodeBlock(x=direction_2) { x.X; }
code_block_25 = CodeBlock { 0; }
ge = code_block_24 >= code_block_25
reverse_2 = Curve.Reverse(curve=code_block_23)
scopeIf_2 = Custom[ScopeIf+](test=ge, True=reverse_2, False=code_block_23, lacing=Shortest)
direction_3 = Line.Direction(line=scopeIf_2)
normalized_2 = Vector.Normalized(vector=direction_3)
code_block_26 = CodeBlock(x=normalized_2) { x.X; }
code_block_27 = CodeBlock { 0; }
eq_3 = code_block_26 == code_block_27
code_block_28 = CodeBlock(x=normalized_2) { x.Y; }
code_block_29 = CodeBlock { 0; }
gt = code_block_28 > code_block_29
and_ = eq_3 && gt
reverse_3 = Curve.Reverse(curve=scopeIf_2)
scopeIf_3 = Custom[ScopeIf+](test=and_, True=reverse_3, False=scopeIf_2, lacing=Shortest)
code_block_30 = CodeBlock { "Levels"; }
byName_3 = Category.ByName(name=code_block_30)
all_elements_of_category_2 = ElementsOfCategory(Category=byName_3)
elevation = Level.Elevation(level=all_elements_of_category_2)
minimumItem = List.MinimumItem(list=elevation)
eq_4 = elevation == minimumItem
filterByBoolMask_3 = List.FilterByBoolMask(list=all_elements_of_category_2, mask=eq_4)
plane = Custom[Level.Plane](level=filterByBoolMask_3.in)  # package Clockwork for Dynamo 2.x; Retrieves the plane of a given level
pullOntoPlane = Curve.PullOntoPlane(curve=scopeIf_3, plane=plane, lacing=Longest)
ZAxis = Vector.ZAxis()
code_block_31 = CodeBlock { -3000; }
translate = Geometry.Translate(geometry=pullOntoPlane, direction=ZAxis, distance=code_block_31, lacing=Longest)
code_block_32 = CodeBlock { "Building Section (02_MA)"; }
byName_4 = Orchid.RevitProject.Views.ViewType.ByName(name=code_block_32)
code_block_33 = CodeBlock { 0.5; }
pointAtParameter = Curve.PointAtParameter(curve=translate, param=code_block_33)
code_block_34 = CodeBlock { "Levels"; }
byName_5 = Category.ByName(name=code_block_34)
all_elements_of_category_3 = ElementsOfCategory(Category=byName_5)
elevation_2 = Level.Elevation(level=all_elements_of_category_3)
maximumItem = List.MaximumItem(list=elevation_2)
eq_5 = elevation_2 == maximumItem
filterByBoolMask_4 = List.FilterByBoolMask(list=all_elements_of_category_3, mask=eq_5)
plane_2 = Custom[Level.Plane](level=filterByBoolMask_4.in)
pullOntoPlane_2 = Curve.PullOntoPlane(curve=scopeIf_3, plane=plane_2, lacing=Longest)
ZAxis_2 = Vector.ZAxis()
code_block_35 = CodeBlock { 3000; }
translate_2 = Geometry.Translate(geometry=pullOntoPlane_2, direction=ZAxis_2, distance=code_block_35, lacing=Longest)
code_block_36 = CodeBlock { 0.5; }
pointAtParameter_2 = Curve.PointAtParameter(curve=translate_2, param=code_block_36)
distanceTo = Geometry.DistanceTo(geometry=pointAtParameter, other=pointAtParameter_2)
code_block_37 = CodeBlock { null; }
replaceEmptyLists_2 = Custom[List.ReplaceEmptyLists](seq=distanceTo, Replacement=code_block_37)
code_block_38 = CodeBlock(x=replaceEmptyLists_2)
# ---------- code_block_38.designscript (12 lines) ----------
x;
[Imperative]
{
	if(x == null)
	{
		return = [[]];
	}
	else
	{
		return = x;
	}
};
# ----------------------------------------
code_block_39 = CodeBlock(h=code_block_38.out1)
# ---------- code_block_39.designscript (6 lines) ----------
//height
h[0];
//offset
300;
//depth
300;
# ----------------------------------------
byLine = Custom[ViewSection.ByLine](Curves=translate, ViewFamilyType=byName_4, ViewSectionHeight=code_block_39.out0, OffsetFromLine=code_block_39.out1, Depth=code_block_39.out2)  # package Data-Shapes; Create ViewSections in current document from DS Lines.
code_block_40 = CodeBlock(g=code_block_19) { "View Name"; "MA_ELEVACION EJE "+Revit.Elements.Element.Name(g); }
setParameterByName = Element.SetParameterByName(element=byLine, parameterName=code_block_40.out0, value=code_block_40.out1, lacing=Longest)
code_block_41 = CodeBlock(g=code_block_19) { "Title on Sheet"; "ELEVACIÓN EJE "+Revit.Elements.Element.Name(g); }
setParameterByName_2 = Element.SetParameterByName(element=setParameterByName, parameterName=code_block_41.out0, value=code_block_41.out1, lacing=Longest)
code_block_42 = CodeBlock(l=code_block_18.out1) { l[1]; }
setScale = View.SetScale(view=setParameterByName_2, scale=code_block_42, lacing=Longest)
code_block_43 = CodeBlock()
# ---------- code_block_43.designscript (5 lines) ----------
[
"Crop View",
"Crop Region Visible"
];
[0,0];
# ----------------------------------------
setParameterByName_3 = Element.SetParameterByName(element=setScale@L1, parameterName=code_block_43.out0@L2, value=code_block_43.out1@L2, lacing=Longest)
flatten = List.Flatten(list=setParameterByName_3)
uniqueItems = List.UniqueItems(list=flatten)
all_elements_in_view_s = Custom[All Elements In View(s)](Views=uniqueItems)  # package Data-Shapes; Retrieves all visible element in a view or a set of views
code_block_44 = CodeBlock { "View Name"; }
exists = Orchid.RevitProject.Parameters.Parameter.Exists(parameterName=code_block_44, element=all_elements_in_view_s)
filterByBoolMask_5 = List.FilterByBoolMask(list=all_elements_in_view_s, mask=exists)
code_block_45 = CodeBlock { "Type"; }
getParameterValueByName_3 = Element.GetParameterValueByName(element=filterByBoolMask_5.in, parameterName=code_block_45)
name = Orchid.RevitProject.Elements.ElementType.Name(elementType=getParameterValueByName_3)
code_block_46 = CodeBlock { "Building Section (02_MA)"; }
eq_6 = name == code_block_46
filterByBoolMask_6 = List.FilterByBoolMask(list=filterByBoolMask_5.in, mask=eq_6)
function_apply = ApplyFunction(func=hideElements, arg1=uniqueItems, arg2=filterByBoolMask_6.in)
code_block_47 = CodeBlock { null; }
replaceEmptyLists_3 = Custom[List.ReplaceEmptyLists](seq=function_apply, Replacement=code_block_47)
end = Revit.Transaction.Transaction.End(input=replaceEmptyLists_3)
code_block_48 = CodeBlock(x=end)
# ---------- code_block_48.designscript (13 lines) ----------
x;

[Imperative]
{
	if(x == null)
	{
		return = [];
	}
	else
	{
		return = "Section";
	}
};
# ----------------------------------------
getByType = archilab.Revit.Views.Views.GetByType(viewType=code_block_48.out1)
all_elements_in_view_s_2 = Custom[All Elements In View(s)](Views=getByType)
code_block_49 = CodeBlock { "View Name"; }
exists_2 = Orchid.RevitProject.Parameters.Parameter.Exists(parameterName=code_block_49, element=all_elements_in_view_s_2)
filterByBoolMask_7 = List.FilterByBoolMask(list=all_elements_in_view_s_2, mask=exists_2)
hideElements_2 = archilab.Revit.Views.Views.HideElements(view=getByType, elements=filterByBoolMask_7.in)
end_2 = Revit.Transaction.Transaction.End(input=uniqueItems)

# group: Etiqueta Vigas
code_block_50 = CodeBlock { null; }
replaceEmptyLists_4 = Custom[List.ReplaceEmptyLists](seq=end_2, Replacement=code_block_50)
code_block_51 = CodeBlock(x=replaceEmptyLists_4)
# ---------- code_block_51.designscript (13 lines) ----------
x;

[Imperative]
{
	if(x == null)
	{
		return = [];
	}
	else
	{
		return = x;
	}
};
# ----------------------------------------
code_block_52 = CodeBlock(x=code_block_51.out1) { x; }
code_block_53 = CodeBlock { "Structural Framing"; }
byName_6 = Category.ByName(name=code_block_53)
all_elements_of_category_in_view = ElementsOfCategoryInView(Category=byName_6, View=code_block_52)
familyName = Orchid.RevitProject.Elements.Element.FamilyName()  # unwired: element
function_apply_2 = ApplyFunction(func=familyName, arg1=all_elements_of_category_in_view)
code_block_54 = CodeBlock()
# ---------- code_block_54.designscript (6 lines) ----------
[
"EST_M_STRUCTURAL FRAMING_VIGA INVERTIDA",
"EST_M_STRUCTURAL FRAMING_VIGA SEMI INVERTIDA",
"EST_M_STRUCTURAL FRAMING_VIGA TRADICIONAL",
"EST_M_STRUCTURAL FRAMING_VIGA FUNDACION"
];
# ----------------------------------------
eq_7 = function_apply_2@@L1 == code_block_54@L2  # lacing=Longest
anyTrue_2 = Orchid.Common.List.AnyTrue(list=eq_7@@L2)
code_block_55 = CodeBlock { []; }
replacenulls = Custom[© ReplaceNulls](lst=anyTrue_2, replace=code_block_55)  # package Crumple; Replaces all nulls with a given substitute.
filterByBoolMask_8 = List.FilterByBoolMask(list=all_elements_of_category_in_view@L2, mask=replacenulls@L2)
direction_4 = Line.Direction()  # unwired: line
location = Custom[Element.Location+](element=filterByBoolMask_8.in@L2)  # package Clockwork for Dynamo 2.x; Returns the location of an element as point, curve or curve loop, along with some booleans to help filtering the results. Unlike the OOTB Element.GetLocation node, it also retunrs sketch lines of sketch-based elements like floor slabs as well as the element's rotation property.
code_block_56 = CodeBlock(x=location.curves)
# ---------- code_block_56.designscript (12 lines) ----------
x;
[Imperative]
{
	if(x == null)
	{
		return = [];
	}
	else
	{
		return = x;
	}
};
# ----------------------------------------
function_apply_3 = ApplyFunction(func=direction_4, arg1=code_block_56.out1)
code_block_57 = CodeBlock { []; }
replacenulls_2 = Custom[© ReplaceNulls](lst=function_apply_3, replace=code_block_57)
code_block_58 = CodeBlock(x=code_block_51.out1) { x; }
plane_3 = Custom[View.Plane](view=code_block_58)  # package Clockwork for Dynamo 2.x; Retrieves the plane of a given view
isParallelToPlane = Custom[Vector.IsParallelToPlane](vector=replacenulls_2, plane=plane_3, lacing=Longest)  # package Clockwork for Dynamo 2.x; Checks if a given vector is parallel to a given plane
filterByBoolMask_9 = List.FilterByBoolMask(list=filterByBoolMask_8.in, mask=isParallelToPlane)
element_taggedstatus = Custom[Element TaggedStatus](element=filterByBoolMask_9.in)  # package Genius Loci; Identify the tagged and untagged elements. Please note : This doesn't work with areas and spaces.
elementcentroid = Custom[© ElementCentroid](element=element_taggedstatus.NotTagged)  # package Crumple; Returns the centroid of the element's axis-aligned bounding box.
code_block_59 = CodeBlock { 0.5; }
planeAtParameter = Curve.PlaneAtParameter(param=code_block_59)  # unwired: curve
location_2 = Custom[Element.Location+](element=element_taggedstatus.NotTagged@L2)
code_block_60 = CodeBlock(x=location_2.curves)  # same code as code_block_56
function_apply_4 = ApplyFunction(func=planeAtParameter, arg1=code_block_60.out1)
code_block_61 = CodeBlock { []; }
replacenulls_3 = Custom[© ReplaceNulls](lst=function_apply_4, replace=code_block_61)
code_block_62 = CodeBlock { 0.5; }
pointAtParameter_3 = Curve.PointAtParameter(param=code_block_62)  # unwired: curve
function_apply_5 = ApplyFunction(func=pointAtParameter_3, arg1=code_block_60.out1)
code_block_63 = CodeBlock { []; }
replacenulls_4 = Custom[© ReplaceNulls](lst=function_apply_5, replace=code_block_63)
plane_4 = Custom[View.Plane](view=code_block_58)
normal = Plane.Normal(plane=plane_4)
code_block_64 = CodeBlock { 90; }
rotate = Geometry.Rotate(geometry=replacenulls_3@L2, origin=replacenulls_4@L2, axis=normal@L1, degrees=code_block_64@L1, lacing=Longest)
normal_2 = Plane.Normal(plane=rotate)
Z = Vector.Z(vector=normal_2)
code_block_65 = CodeBlock { 0; }
gt_2 = Z > code_block_65
code_block_66 = CodeBlock { -1; }
ne = Z != code_block_66
and_2 = gt_2 && ne
reverse_4 = Vector.Reverse(vector=normal_2)
scopeIf_4 = Custom[ScopeIf+](test=and_2@@L1, True=normal_2@L1, False=reverse_4@L1, lacing=Shortest)
code_block_67 = CodeBlock { []; }
replacenulls_5 = Custom[© ReplaceNulls](lst=scopeIf_4, replace=code_block_67)
code_block_68 = CodeBlock(x=element_taggedstatus.NotTagged) { Revit.Elements.Element.GetParameterValueByName(Revit.Elements.Element.GetParameterValueByName(x,"Type"),"Height")/2; }
translate_3 = Geometry.Translate(geometry=elementcentroid, direction=replacenulls_5, distance=code_block_68)
list_create_2 = List.Create(item0=elementcentroid, item1=translate_3)
transpose = List.Transpose(lists=list_create_2@L4)
transpose_2 = List.Transpose(lists=transpose@L3)
byElementAndLocation = Tag.ByElementAndLocation(view=code_block_52@L1, element=element_taggedstatus.NotTagged@L2, location=transpose_2@L3, lacing=Longest)
list_clean = Custom[List Clean](list=byElementAndLocation)  # package Genius Loci; Removes all Null, Empty and Blank from a list or nested list of lists.
code_block_69 = CodeBlock { null; }
replaceEmptyLists_5 = Custom[List.ReplaceEmptyLists](seq=list_clean, Replacement=code_block_69)
code_block_70 = CodeBlock(x=replaceEmptyLists_5)
# ---------- code_block_70.designscript (12 lines) ----------
x;
[Imperative]
{
	if(x == null)
	{
		return = [null,null];
	}
	else
	{
		return = x;
	}
};
# ----------------------------------------
code_block_71 = CodeBlock { 1; }
getItemAtIndex_2 = List.GetItemAtIndex(list=code_block_70.out1@L2, index=code_block_71)
code_block_72 = CodeBlock(x=getItemAtIndex_2)
# ---------- code_block_72.designscript (12 lines) ----------
x;
[Imperative]
{
	if(x[0] == null)
	{
		return = [];
	}
	else
	{
		return = x;
	}
};
# ----------------------------------------
code_block_73 = CodeBlock { "Type"; }
code_block_74 = CodeBlock { "EST_A_STRUCTURAL FRAMING TAG_ELEVACION"; }
byName_7 = Orchid.RevitProject.Elements.Family.ByName(name=code_block_74)
code_block_75 = CodeBlock { "Tag Viga"; }
byFamilyAndName = FamilyType.ByFamilyAndName(family=byName_7, name=code_block_75)
setParameterByName_4 = Element.SetParameterByName(element=code_block_72.out1, parameterName=code_block_73, value=byFamilyAndName)
code_block_76 = CodeBlock { 0; }
getItemAtIndex_3 = List.GetItemAtIndex(list=code_block_70.out1@L2, index=code_block_76)
code_block_77 = CodeBlock(x=getItemAtIndex_3)  # same code as code_block_72
code_block_78 = CodeBlock { "Type"; }
code_block_79 = CodeBlock { "EST_A_STRUCTURAL FRAMING TAG_ELEVACION_ESTRIBO Y LATERAL"; }
byName_8 = Orchid.RevitProject.Elements.Family.ByName(name=code_block_79)
code_block_80 = CodeBlock { "Estribo Simple y Laterales"; }
byFamilyAndName_2 = FamilyType.ByFamilyAndName(family=byName_8, name=code_block_80)
setParameterByName_5 = Element.SetParameterByName(element=code_block_77.out1, parameterName=code_block_78, value=byFamilyAndName_2)
