# Dynamo graph etiquetadoElevMA_script.dyn (Dynamo 2.3.1.11775)
# packages: Orchid 200.4.0.7938, Clockwork for Dynamo 2.x 2.4.0, archi-lab.net 2022.210.2419, Crumple 2022.2.13, Genius Loci 2020.8.3

activeView = Orchid.RevitProject.Common.Document.ActiveView()
code_block = CodeBlock { "Walls"; }
byName = Category.ByName(name=code_block)
activeView_2 = Orchid.RevitProject.Common.Document.ActiveView()
code_block_2 = CodeBlock(x=activeView_2) { x; }
all_elements_of_category_in_view = ElementsOfCategoryInView(Category=byName, View=code_block_2)
wallType = archilab.Revit.Elements.Walls.WallType(wall=all_elements_of_category_in_view)
kind = Orchid.RevitProject.Elements.WallType.Kind(wallType=wallType)
code_block_3 = CodeBlock { "Basic"; }
eq = kind == code_block_3
filterByBoolMask = List.FilterByBoolMask(list=all_elements_of_category_in_view, mask=eq)
getMaterials = Element.GetMaterials(element=filterByBoolMask.in)
flatten = List.Flatten(list=getMaterials)
name = Material.Name(material=flatten)
code_block_4 = CodeBlock { "Concrete, Cast-in-Place gray"; }
eq_2 = name == code_block_4
filterByBoolMask_2 = List.FilterByBoolMask(list=filterByBoolMask.in, mask=eq_2)
location = Custom[Element.Location+](element=filterByBoolMask_2.in)  # package Clockwork for Dynamo 2.x; Returns the location of an element as point, curve or curve loop, along with some booleans to help filtering the results. Unlike the OOTB Element.GetLocation node, it also retunrs sketch lines of sketch-based elements like floor slabs as well as the element's rotation property.
direction = Line.Direction(line=location.curves)
activeView_3 = Orchid.RevitProject.Common.Document.ActiveView()
plane = Custom[View.Plane](view=activeView_3)  # package Clockwork for Dynamo 2.x; Retrieves the plane of a given view
isParallelToPlane = Custom[Vector.IsParallelToPlane](vector=direction, plane=plane)  # package Clockwork for Dynamo 2.x; Checks if a given vector is parallel to a given plane
filterByBoolMask_3 = List.FilterByBoolMask(list=filterByBoolMask_2.in, mask=isParallelToPlane)
element_taggedstatus = Custom[Element TaggedStatus](element=filterByBoolMask_3.in)  # package Genius Loci; Identify the tagged and untagged elements. Please note : This doesn't work with areas and spaces.
code_block_5 = CodeBlock { "EST_A_WALL TAG_ELEVACION_MHA"; }
byName_2 = Orchid.RevitProject.Elements.Family.ByName(name=code_block_5)
code_block_6 = CodeBlock { "Doble Malla"; }
byFamilyAndName = FamilyType.ByFamilyAndName(family=byName_2, name=code_block_6)
elementcentroid = Custom[© ElementCentroid](element=element_taggedstatus.NotTagged)  # package Crumple; Returns the centroid of the element's axis-aligned bounding box.
byElementAndLocation = Orchid.RevitProject.Annotations.Tag.ByElementAndLocation(view=activeView, element=element_taggedstatus.NotTagged, tagType=byFamilyAndName, location=elementcentroid, lacing=Longest)
